# Grasshopper definition Optitrack.gh (Grasshopper 1.0.7)
# plug-ins: OptitrackGH_Plane

connect = BooleanToggle(False)
# COMPAS_Get Rigid Body Frame from Optitrack
panel = Panel("192.168.100.170")
ros = ROSConnect(ip=panel, port="9090", connect=connect)  # -> ros_client, is_connected; inputs port: Int32, connect: Boolean
#   port ip: The ip address ROS. Defaults to 127.0.0.1.
#   port port: The port of ROS. Defaults to 9090.
#   port connect: If True, connects to ROS. If False, disconnects from ROS. Defaults to False.
#   port ros_client: The ROS client.
#   port is_connected: True if connection established.
# ---------- ros: Python ----------
"""
Connect or disconnect to ROS.

COMPAS FAB v0.27.0
"""
from ghpythonlib.componentbase import executingcomponent as component
from scriptcontext import sticky as st

from compas_fab.backends import RosClient
from compas_fab.ghpython.components import create_id


class ROSConnect(component):
    def RunScript(self, ip, port, connect):
        ros_client = None

        ip = ip or '127.0.0.1'
        port = port or 9090

        key = create_id(self, 'ros_client')
        ros_client = st.get(key, None)

        if ros_client:
            st[key].close()
        if connect:
            st[key] = RosClient(ip, port)
            st[key].run(5)

        ros_client = st.get(key, None)
        is_connected = ros_client.is_connected if ros_client else False
        return (ros_client, is_connected)
# ---------- end ros ----------
ros_client = Data(ros.ros_client)
subscribe = SubscribeToTopic(
    ros_client=ros_client,
    topic_name="/vrpn_client_node/RigidBody20/pose",
    topic_type="geometry_msgs/PoseStamped",
    interval=Slider(100, range=0..1000),
    start=Button(),
    stop=Button())  # -> topic, last_msg, is_subscribed; inputs interval: Int32, start: Boolean, stop: Boolean
#   port ros_client: The ROS client.
#   port topic_name: Name of the topic to subscribe to, eg. /joint_states
#   port topic_type: Type of the topic to subscribe to, eg. sensor_msgs/JointState
#   port interval: Interval in milliseconds at which to expire the solution to propagate received messages. Defaults to 25ms. Messages are not queued, so if the interval is greater than the rate at which messages are published, some messages will be dropped.
#   port start: Start receiving messages.
#   port stop: Stop receiving messages.
#   port topic: The subscribed topic instance.
#   port last_msg: The last received message.
#   port is_subscribed: Indicates if the topic is currently subscribed or not.
# ---------- subscribe: Python ----------
"""
Subscribe to a ROS topic.

COMPAS FAB v0.27.0
"""
import time

import Grasshopper.Kernel
from ghpythonlib.componentbase import executingcomponent as component
from roslibpy import Topic
from scriptcontext import sticky as st

from compas_fab.backends.ros.messages import ROSmsg
from compas_fab.ghpython.components import create_id


class ROSTopicSubscribe(component):
    def RunScript(self, ros_client, topic_name, topic_type, interval, start, stop):
        if not topic_name:
            raise ValueError('Please specify the name of the topic')
        if not topic_type:
            raise ValueError('Please specify the type of the topic')

        if not hasattr(self, 'message_count'):
            self.message_count = 0

        self.interval = interval or 25  # in milliseconds
        self.is_updating = False
        self.is_subscribed = False

        self.msg_key = create_id(self, 'last_msg')
        key = create_id(self, 'topic')

        last_msg = st.get(self.msg_key, None)
        topic = st.get(key, None)

        if ros_client and ros_client.is_connected:
            if start:
                self._unsubscribe(topic)

                topic = Topic(ros_client, topic_name, topic_type)
                topic.subscribe(self.topic_callback)
                time.sleep(0.2)

                st[key] = topic

            if stop:
                self._unsubscribe(topic)

        self.is_subscribed = topic and topic.is_subscribed

        if last_msg:
            last_msg = ROSmsg.parse(last_msg, topic_type)

        if self.is_subscribed:
            self.Message = 'Subscribed, {} messages'.format(self.message_count)
        else:
            self.Message = 'Not subscribed'

        return (topic, last_msg, self.is_subscribed)

    def _unsubscribe(self, topic):
        if topic and topic.is_subscribed:
            topic.unsubscribe()
            time.sleep(0.2)

    def topic_callback(self, msg):
        self.message_count += 1
        st[self.msg_key] = msg

        if self.is_subscribed:
            ghdoc = ghenv.Component.OnPingDocument()     # noqa: F821 This is defined by Grasshopper
            if not self.is_updating and ghdoc.SolutionState != Grasshopper.Kernel.GH_ProcessStep.Process:
                self.is_updating = True
                ghdoc.ScheduleSolution(
                    self.interval, Grasshopper.Kernel.GH_Document.GH_ScheduleDelegate(self.expire_callback))

    def expire_callback(self, ghdoc):
        if ghdoc.SolutionState != Grasshopper.Kernel.GH_ProcessStep.Process:
            ghenv.Component.ExpireSolution(False)        # noqa: F821 This is defined by Grasshopper
        self.is_updating = False
# ---------- end subscribe ----------
panel_2 = Panel(ros.is_connected)

c_script = CSharpScript(pose=subscribe.last_msg)  # -> Plane
# ---------- c_script: C# ----------
    dynamic dynPose = pose;
    var position = dynPose.pose.position;
    var orientation = dynPose.pose.orientation;
    double x = position.x * 1000;
    double y = position.y * 1000;
    double z = position.z * 1000;

    Tuple<double,double,double> euler = q_to_euler(orientation.x, orientation.y, orientation.z, orientation.w);
    //    Rhino.RhinoApp.WriteLine("Rx:" + euler.Item1 + " Ry:" + euler.Item2 + " Rz:" + euler.Item3 );

    var p = new Plane(new Point3d(x, y, z), new Vector3d(1, 0, 0), new Vector3d(0, 1, 0));
    p.Transform(Transform.Rotation(euler.Item3, p.Origin));
    p.Transform(Transform.Rotation(euler.Item2, p.YAxis, p.Origin));
    p.Transform(Transform.Rotation(euler.Item1, p.XAxis, p.Origin));

    Plane = p;
# ---------- c_script: C# additional code ----------
  private Tuple<double,double,double> q_to_euler(double x, double y, double z, double w){
    double sinr_cosp = 2 * (w * x + y * z);
    double cosr_cosp = 1 - 2 * (x * x + y * y);
    double rx = Math.Atan2(sinr_cosp, cosr_cosp);

    double sinp = Math.Sqrt(1 + 2 * (w * y - x * z));
    double cosp = Math.Sqrt(1 - 2 * (w * y - x * z));
    double ry = 2 * Math.Atan2(sinp, cosp) - Math.PI / 2;

    double siny_cosp = 2 * (w * z + x * y);
    double cosy_cosp = 1 - 2 * (y * y + z * z);

    double rz = Math.Atan2(siny_cosp, cosy_cosp);

    return Tuple.Create(rx, ry, rz);

  }
# ---------- end c_script ----------
optitrackplane = OptitrackGHPlane(Pose=subscribe.last_msg)
python = GhPythonScript(pose=subscribe.last_msg)  # -> plane
# ---------- python: Python ----------
__author__ = "bmade"
__version__ = "2024.02.26"

import rhinoscriptsyntax as rs
from compas.geometry import Frame
from compas.geometry import Rotation
from compas.geometry import Vector
import math

#https://en.wikipedia.org/wiki/Conversion_between_quaternions_and_Euler_angles
def q_to_euler(x,y,z,w):
    sinr_cosp = 2 * (w * x + y * z)   
    cosr_cosp = 1 - 2 * (x * x + y * y)
    rx = math.atan2(sinr_cosp,cosr_cosp)    
        
    sinp = math.sqrt(1 + 2 * (w * y - x * z))
    cosp = math.sqrt(1 - 2 * (w * y - x * z))    
    ry = 2 * math.atan2(sinp,cosp) - math.pi / 2
    
    siny_cosp = 2 * (w * z + x * y)
    cosy_cosp = 1 - 2 * (y * y + z * z)
    rz = math.atan2(siny_cosp,cosy_cosp)
    
    return rx,ry,rz



#main
pos = pose.pose.position
x = pos.x *1000
y = pos.y * 1000
z = pos.z * 1000

orientation = pose.pose.orientation
rx,ry,rz = q_to_euler(orientation.x,orientation.y,orientation.z,orientation.w)

f = Frame.from_euler_angles([rx,ry,rz],static=True,axes='xyz')

x_axis = rs.CreateVector(f[1])
y_axis = rs.CreateVector(f[2])
pt = rs.CreatePoint(x,y,z)
plane = rs.CreatePlane(pt,x_axis,y_axis)
# ---------- end python ----------
panel_3 = Panel(python)
python_2 = GhPythonScript(msg=subscribe.last_msg)  # -> out, x, y, z; inputs msg: list
# ---------- python_2: Python ----------
import rhinoscriptsyntax as rs
msg=str(msg)
print msg
import re
a = re.split('Point|, orientation', msg)
x = re.split('x=|,',a[1])
y = re.split('y=|,',a[1])
z = re.split('z=|,',a[1])
z = z[3].replace(")", "")
x=float(x[1])*1000
y=float(y[2])*1000
z=float(z)*1000
print z
# ---------- end python_2 ----------
